# Grasshopper definition virtual_agent.gh (Grasshopper 0.9.76)
# plug-ins: Firefly.Core

timer = Timer(TimerInterval=5, Target=serial_read_generic)
serial_read_generic = SerialReadGeneric(StartReadingValues=Toggle(True), PortNumber="4")  # -> SerialOutput, StatusMessage
open_close_port = OpenClosePort(OpenClosePort=Toggle(True), PortNumber="4", BaudRate="115200")
panel = Panel(serial_read_generic.StatusMessage)
panel_2 = Panel(open_close_port)
text_split = TextSplit(Text=serial_read_generic.SerialOutput)
number = Number(0)
list_item = ListItem(List=text_split, Index=number, Wrap=True)
text_split_2 = TextSplit(Text=list_item, Separators="\t")
panel_3 = Panel(text_split_2)
number_2 = Number(3)
number_3 = Number(4)
number_4 = Number(5)
domain = Domain(Domain(0, 2))
glow = ListItem(List=panel_3, Index=number_2, Wrap=True)
texture = ListItem(List=panel_3, Index=number_3, Wrap=True)
seed = ListItem(List=panel_3, Index=number_4, Wrap=True)
angles = SubList(List=panel_3, Domain=domain, Wrap=True)  # -> List, Index
number_5 = Number(texture)
number_6 = Number(angles.List)
number_7 = Number(0)
number_8 = Number(2)
number_9 = Number(1)
list_item_2 = ListItem(List=number_6, Index=number_7, Wrap=True)
list_item_3 = ListItem(List=number_6, Index=number_8, Wrap=True)
list_item_4 = ListItem(List=number_6, Index=number_9, Wrap=True)
number_10 = Number(-1)
multiplication = Multiplication(A=list_item_2, B=number_10)
seed_2 = Number(seed)

# ---- group: Sphere Point Generation
number_slider = Slider(12, range=0..100)
number_slider_2 = Slider(8, range=0..20)
mesh_sphere = MeshSphere(Base=PlaneXY(0, 0, 0), Radius=number_slider_2, UCount=number_slider, VCount=number_slider)
sphere = Sphere(Base=PlaneXY(0, 0, 0), Radius=number_slider_2)
multiplication_2 = Multiplication(A=number_slider, B=number_slider)
populate_geometry = PopulateGeometry(Geometry=sphere, Count=multiplication_2, Seed=seed_2)
deconstruct_mesh = DeconstructMesh(Mesh=mesh_sphere)  # -> Vertices, Faces, Colours, Normals
closest_point = ClosestPoint(Point=deconstruct_mesh.Vertices, Cloud=populate_geometry)  # -> ClosestPoint, CPIndex, Distance

# ----
number_11 = Number(4)
multiplication_3 = Multiplication(A=number_5, B=number_11)

# ---- group: Random Surface Displacement
list_length = ListLength(List=closest_point.ClosestPoint)
domain_2 = Domain(Domain(-0.2, 0.2))
random = Random(Range=domain_2, Number=list_length, Seed=seed_2)
multiplication_4 = Multiplication(A=closest_point.ClosestPoint, B=random)
multiplication_5 = Multiplication(A=multiplication_4, B=multiplication_3)
addition = Addition(A=closest_point.ClosestPoint, B=multiplication_5)

# ----
number_12 = Number(0.85)
glow_2 = Number(glow)
multiplication_6 = Multiplication(A=glow_2, B=number_12)
unit_z = UnitZ(Factor=1)
colour_hsl = ColourHSL(Alpha=1, Hue=0, Saturation=Slider(0, range=0..1), Luminance=multiplication_6)
unit_y = UnitY(Factor=1)
unit_x = UnitX(Factor=1)

# ---- group: Particles Explosion
number_13 = Number(15)
multiplication_7 = Multiplication(A=number_5, B=number_13)
sphere_2 = Sphere(Base=PlaneXY(0, 0, 0), Radius=multiplication_7)
construct_point = ConstructPoint(XCoordinate=0, YCoordinate=0, ZCoordinate=0)
populate_3d = Populate3D(Region=sphere_2, Count=Slider(49, range=0..100), Seed=seed_2)
distance = Distance(PointA=populate_3d, PointB=construct_point)
gaussian = Expression(x=distance, a=Slider(5.2, range=0..10), c=Slider(7.7, range=0..10), Expression="a*e^-((x)^2/(2*c*c))")
number_14 = Number(3)
polygon = Polygon(Plane=populate_3d, Radius=gaussian, Segments=number_14, FilletRadius=0)  # -> Polygon, Length

# ---- group: Particles Explosion / Random Axis Rotation
xy_plane = XYPlane(Origin=Point(0, 0, 0))
list_length_2 = ListLength(List=polygon.Polygon)
domain_3 = Domain(Domain(0, 6.283185307))
random_2 = Random(Range=domain_3, Number=list_length_2, Seed=2)
rotate_3d = Rotate3D(Geometry=polygon.Polygon, Angle=random_2, Center=Point(0, 0, 0), Axis=xy_plane)  # -> Geometry, Transform
xz_plane = XZPlane(Origin=Point(0, 0, 0))
rotate_3d_2 = Rotate3D(Geometry=rotate_3d.Geometry, Angle=random_2, Center=Point(0, 0, 0), Axis=xz_plane)  # -> Geometry, Transform
yz_plane = YZPlane(Origin=Point(0, 0, 0))
rotate_3d_3 = Rotate3D(Geometry=rotate_3d_2.Geometry, Angle=random_2, Center=Point(0, 0, 0), Axis=yz_plane)  # -> Geometry, Transform

# ---- group: Particles Explosion (continued)
boundary_surfaces = BoundarySurfaces(Edges=rotate_3d_3.Geometry)

# ----
mesh = Mesh(boundary_surfaces)

# ---- group: Mesh Building
construct_mesh = ConstructMesh(Vertices=addition, Faces=deconstruct_mesh.Faces)
triangulate = Triangulate(Mesh=construct_mesh)  # -> Mesh, Count
deconstruct_mesh_2 = DeconstructMesh(Mesh=triangulate.Mesh)  # -> Vertices, Faces, Colours, Normals
construct_mesh_2 = ConstructMesh(Vertices=deconstruct_mesh_2.Vertices, Faces=graft(deconstruct_mesh_2.Faces))  # -> flatten(Mesh)

# ----
group = Group(Objects=[construct_mesh_2, mesh])

# ---- group: Mesh Building (continued)
rotate_3d_4 = Rotate3D(Geometry=group, Angle=multiplication, Center=Point(0, 0, 0), Axis=unit_z)  # -> Geometry, Transform

# ----
rotate_3d_5 = Rotate3D(Geometry=rotate_3d_4.Geometry, Angle=list_item_4, Center=Point(0, 0, 0), Axis=unit_y)  # -> Geometry, Transform
rotate_3d_6 = Rotate3D(Geometry=rotate_3d_5.Geometry, Angle=list_item_3, Center=Point(0, 0, 0), Axis=unit_x)  # -> Geometry, Transform

# ---- group: Rendering
arduino_saturation = Slider(0, range=0..1)
arduino_hue = Slider(0, range=0..1)
colour_hsl_2 = ColourHSL(Alpha=1, Hue=arduino_hue, Saturation=arduino_saturation, Luminance=Slider(0.41, range=0..1))
create_material = CreateMaterial(Diffuse=colour_hsl_2, Specular=RGB(255, 255, 255), Emission=colour_hsl, Transparency=0, Shine=Slider(100, range=0..100))
custom_preview = CustomPreview(Geometry=rotate_3d_6.Geometry, Shader=create_material)
